# Dynamo custom node Stacked Cuboids.dyf (Dynamo 0.9.0.3067)
# category: DPK
# A vertical stack of rotated cubes

Cuboid_Width = Input()
Cuboid_Depth = Input()
byLengths = Cuboid.ByLengths(width=Cuboid_Width, length=Cuboid_Width, height=Cuboid_Depth)
origin = Point.Origin()
YAxis = Vector.YAxis()
Rotation_from_Horizontal = Input()
rotate = Geometry.Rotate(geometry=byLengths, origin=origin, axis=YAxis, degrees=Rotation_from_Horizontal)
ZAxis = Vector.ZAxis()
Number_of_repeats = Input()
Gap = Input()
code_block = CodeBlock(depth=Cuboid_Depth, ang=Rotation_from_Horizontal) { depth / Math.Cos(ang); }
code_block_2 = CodeBlock(gap=Gap, vdepth=code_block) { gap + vdepth; }
code_block_3 = CodeBlock(num=Number_of_repeats, dist=code_block_2) { 0..#num..dist; }
translate = Geometry.Translate(geometry=rotate, direction=ZAxis, distance=code_block_3)
byUnion = Solid.ByUnion(translate)
Solid = Output(byUnion)
