# Dynamo graph stand.dyn (Dynamo 0.9.0.3067)

number_slider = DoubleSlider(42, range=0..75 step 1)
number_slider_2 = DoubleSlider(1.3, range=0.1..5 step 0.1)
number = DoubleInput(20)
number_2 = DoubleInput(10)
number_slider_3 = DoubleSlider(1.8, range=0..5 step 0.1)
stacked_cuboids = Custom[Stacked Cuboids](Rotation_from_Horizontal=number_slider, Cuboid_Depth=number_slider_2, Cuboid_Width=number, Number_of_repeats=number_2, Gap=number_slider_3)  # A vertical stack of rotated cubes
XY = Plane.XY()
number_slider_4 = DoubleSlider(45, range=0..360 step 1)
rotate = Geometry.Rotate(stacked_cuboids, XY, number_slider_4)
number_slider_5 = DoubleSlider(47, range=0..75 step 1)
number_slider_6 = DoubleSlider(1.5, range=0.1..5 step 0.1)
number_slider_7 = DoubleSlider(1.8, range=0..5 step 0.1)
stacked_cuboids_2 = Custom[Stacked Cuboids](Rotation_from_Horizontal=number_slider_5, Cuboid_Depth=number_slider_6, Cuboid_Width=number, Number_of_repeats=number_2, Gap=number_slider_7)
number_slider_8 = DoubleSlider(151, range=0..360 step 1)
rotate_2 = Geometry.Rotate(stacked_cuboids_2, XY, number_slider_8)
union = Solid.Union(rotate, rotate_2)
number_3 = DoubleInput(3)
byCenterPointRadius = Circle.ByCenterPointRadius(radius=number_3)
number_4 = DoubleInput(4)
regularPolygon = Polygon.RegularPolygon(circle=byCenterPointRadius, numberSides=number_4)
number_5 = DoubleInput(20)
extrude = Curve.Extrude(curve=regularPolygon, distance=number_5)
intersect = Geometry.Intersect(geometry=union, other=extrude)
